# Dynamo graph MarkBySpline.dyn (Dynamo 2.12.0.5650)

current = Document.Current()
activeView = Document.ActiveView(document=current)
select_model_elements = DSModelElementsSelection()  # 28 picked in the model
code_block = CodeBlock { true; false; "Left"; "Bottom"; }
code_block_2 = CodeBlock { 3; 6; }
byCoordinates = Vector.ByCoordinates(x=code_block_2.out0, y=code_block_2.out1)
byElement = Tag.ByElement(view=activeView, element=select_model_elements, horizontal=code_block.out0, addLeader=code_block.out1, horizontalAlignment=code_block.out2, verticalAlignment=code_block.out3, offset=byCoordinates)
spline = DSModelElementSelection()  # 1 picked in the model
geometry = Element.Geometry(element=spline)
XY = Plane.XY()
pullOntoPlane = Curve.PullOntoPlane(curve=geometry, plane=XY)
getLocation = Element.GetLocation(element=select_model_elements)
code_block_3 = CodeBlock(loc=getLocation) { Point.X(loc); Point.Y(loc); }
byCoordinates_2 = Point.ByCoordinates(x=code_block_3.out0, y=code_block_3.out1)
closestPointTo = Geometry.ClosestPointTo(geometry=pullOntoPlane, other=byCoordinates_2, lacing=Longest)
parameterAtPoint = Curve.ParameterAtPoint(curve=pullOntoPlane, point=closestPointTo, lacing=Longest)
sortByKey = List.SortByKey(list=select_model_elements, keys=parameterAtPoint)
parameter_to_set = StringInput("Mark")
prefix = StringInput("00")
starting_number = IntegerSlider(1, range=0..100 step 1)
count = List.Count(list=sortByKey.sortedList)
code_block_4 = CodeBlock(n=starting_number, c=count) { n..n+(c-1)..1; }
string_from_object = FromObject(object=code_block_4)
code_block_5 = CodeBlock { "."; }
split = String.Split(string=string_from_object, separator0=code_block_5)
code_block_6 = CodeBlock { 0; }
getItemAtIndex = List.GetItemAtIndex(list=split@L2, index=code_block_6)
add = prefix + getItemAtIndex
setParameterByName = Element.SetParameterByName(element=sortByKey.sortedList, parameterName=parameter_to_set, value=add, lacing=Longest)
name = Element.Name(element=setParameterByName)
code_block_7 = CodeBlock { "CARPORT"; }
startsWith = String.StartsWith(string=name, searchFor=code_block_7)
filterByBoolMask = List.FilterByBoolMask(list=setParameterByName, mask=startsWith)
filterByBoolMask_2 = List.FilterByBoolMask(list=add, mask=startsWith)
suffix = StringInput("C")
add_2 = filterByBoolMask_2.in + suffix
setParameterByName_2 = Element.SetParameterByName(element=filterByBoolMask.in, parameterName=parameter_to_set, value=add_2)
padLeft = String.PadLeft()  # unwired: string, newLength
code_block_8 = CodeBlock { "GARAGE"; }
startsWith_2 = String.StartsWith(string=name, searchFor=code_block_8)
filterByBoolMask_3 = List.FilterByBoolMask(list=setParameterByName, mask=startsWith_2)
filterByBoolMask_4 = List.FilterByBoolMask(list=add, mask=startsWith_2)
suffix_2 = StringInput("G")
add_3 = filterByBoolMask_4.in + suffix_2
setParameterByName_3 = Element.SetParameterByName(element=filterByBoolMask_3.in, parameterName=parameter_to_set, value=add_3)
