# Dynamo graph Mass_Floor_Naming.dyn (Dynamo 2.13.1.3887)

# group: GRABBING ALL MASS FLOORS
categories = Categories("OST_MassFloor")
all_elements_of_category = ElementsOfCategory(Category=categories)

# group: LIST OF ALL AVAILABLE PARAMETERS
code_block = CodeBlock(a=all_elements_of_category) { a[1]; }
parameters = Element.Parameters(element=code_block, lacing=Shortest)
watch = Watch(parameters)

# group: GETTING THE MASS TYPE OF THE MASS FLOOR HOSTS
parameters_2 = Element.Parameters(element=all_elements_of_category, lacing=Longest)
transpose = List.Transpose(lists=parameters_2)
code_block_2 = CodeBlock { 22; }
getItemAtIndex = List.GetItemAtIndex(list=transpose, index=code_block_2)
value = Parameter.Value(parameter=getItemAtIndex)

# group: FILTERING OUT UNITS FOR USES
string = StringInput("A1")
string_2 = StringInput("B1")
string_3 = StringInput("C1")
string_4 = StringInput("D1")
code_block_3 = CodeBlock(x=value, a=string, b=string_2, c=string_3, d=string_4) { x == a || x == b || x ==c || x == d; }
filterByBoolMask = List.FilterByBoolMask(list=all_elements_of_category, mask=code_block_3)

# group: SETTING PARAMETERS
code_block_4 = CodeBlock { "Mark"; "SP - Area - Unit Type"; "SP - Area - Use"; }
set_mark = Element.SetParameterByName(element=all_elements_of_category, parameterName=code_block_4.out0, value=value)
set_sp_area_unit_type = Element.SetParameterByName(element=all_elements_of_category, parameterName=code_block_4.out1, value=value)
code_block_5 = CodeBlock { "UNIT"; }
set_sp_area_use = Element.SetParameterByName(element=filterByBoolMask.in, parameterName=code_block_4.out2, value=code_block_5)
