# Dynamo graph Set_TargetSF.dyn "Set_TarpetSF" (Dynamo 2.13.1.3887)

# group: GRAB ALL AREAS + SORT BY NAME
categories = Categories("OST_Areas")
all_elements_of_category = ElementsOfCategory(Category=categories)
code_block = CodeBlock { "Name"; }
parameterByName = Parameter.ParameterByName(element=all_elements_of_category, name=code_block)
value = Parameter.Value(parameter=parameterByName)

# group: TARGET AREAS + SF
code_block_2 = CodeBlock()
# ---------- code_block_2.designscript (12 lines) ----------
"DAYCARE";
"CLASSROOMS";
"SUPERMARKET";
"EVENT SPACE";
"EACS";
"CO-WORK";
"LIBRARY+STUDY";
"MATH+ROBOTICS";
"A1";
"B1";
"C1";
"D1";
# ----------------------------------------
code_block_3 = CodeBlock { 4000; 4800; 6750; 7000; 10000; 15000; 8000; 5000; 550; 780; 1000; 1200; }

# group: SETTING ALL APPLICABLE TARGET SF PER AREA NAME
code_block_4 = CodeBlock(a=value, b=code_block_2.out0) { a == b; }
filterByBoolMask = List.FilterByBoolMask(list=all_elements_of_category, mask=code_block_4)
string = StringInput("TargetSF")
setParameterByName = Element.SetParameterByName(element=filterByBoolMask.in, parameterName=string, value=code_block_3.out0)
code_block_5 = CodeBlock(a=value, b=code_block_2.out1) { a == b; }
filterByBoolMask_2 = List.FilterByBoolMask(list=all_elements_of_category, mask=code_block_5)
setParameterByName_2 = Element.SetParameterByName(element=filterByBoolMask_2.in, parameterName=string, value=code_block_3.out1)
code_block_6 = CodeBlock(a=value, b=code_block_2.out2) { a == b; }
filterByBoolMask_3 = List.FilterByBoolMask(list=all_elements_of_category, mask=code_block_6)
setParameterByName_3 = Element.SetParameterByName(element=filterByBoolMask_3.in, parameterName=string, value=code_block_3.out2)
code_block_7 = CodeBlock(a=value, b=code_block_2.out3) { a == b; }
filterByBoolMask_4 = List.FilterByBoolMask(list=all_elements_of_category, mask=code_block_7)
setParameterByName_4 = Element.SetParameterByName(element=filterByBoolMask_4.in, parameterName=string, value=code_block_3.out3)
code_block_8 = CodeBlock(a=value, b=code_block_2.out4) { a == b; }
filterByBoolMask_5 = List.FilterByBoolMask(list=all_elements_of_category, mask=code_block_8)
setParameterByName_5 = Element.SetParameterByName(element=filterByBoolMask_5.in, parameterName=string, value=code_block_3.out4)
code_block_9 = CodeBlock(a=value, b=code_block_2.out5) { a == b; }
filterByBoolMask_6 = List.FilterByBoolMask(list=all_elements_of_category, mask=code_block_9)
setParameterByName_6 = Element.SetParameterByName(element=filterByBoolMask_6.in, parameterName=string, value=code_block_3.out5)
code_block_10 = CodeBlock(a=value, b=code_block_2.out6) { a == b; }
filterByBoolMask_7 = List.FilterByBoolMask(list=all_elements_of_category, mask=code_block_10)
setParameterByName_7 = Element.SetParameterByName(element=filterByBoolMask_7.in, parameterName=string, value=code_block_3.out6)
code_block_11 = CodeBlock(a=value, b=code_block_2.out7) { a == b; }
filterByBoolMask_8 = List.FilterByBoolMask(list=all_elements_of_category, mask=code_block_11)
setParameterByName_8 = Element.SetParameterByName(element=filterByBoolMask_8.in, parameterName=string, value=code_block_3.out7)
code_block_12 = CodeBlock(a=value, b=code_block_2.out8) { a == b; }
filterByBoolMask_9 = List.FilterByBoolMask(list=all_elements_of_category, mask=code_block_12)
setParameterByName_9 = Element.SetParameterByName(element=filterByBoolMask_9.in, parameterName=string, value=code_block_3.out8)
code_block_13 = CodeBlock(a=value, b=code_block_2.out9) { a == b; }
filterByBoolMask_10 = List.FilterByBoolMask(list=all_elements_of_category, mask=code_block_13)
setParameterByName_10 = Element.SetParameterByName(element=filterByBoolMask_10.in, parameterName=string, value=code_block_3.out9)
code_block_14 = CodeBlock(a=value, b=code_block_2.out10) { a == b; }
filterByBoolMask_11 = List.FilterByBoolMask(list=all_elements_of_category, mask=code_block_14)
setParameterByName_11 = Element.SetParameterByName(element=filterByBoolMask_11.in, parameterName=string, value=code_block_3.out10)
code_block_15 = CodeBlock(a=value, b=code_block_2.out11) { a == b; }
filterByBoolMask_12 = List.FilterByBoolMask(list=all_elements_of_category, mask=code_block_15)
setParameterByName_12 = Element.SetParameterByName(element=filterByBoolMask_12.in, parameterName=string, value=code_block_3.out11)
